# Grasshopper definition Timber-preview.ghx (Grasshopper 1.0.8)
# plug-ins: Woodie

# ---- group: Solid timber · 120 mm · 11 cases
millimetres = SourceCoordinateUnits("Millimetres")
_01_flat_solid_brep_matched_length = SolidTimber01FlatSolidBrepMatchedLength(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)
_02_extrusion = SolidTimber02Extrusion(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)
_03_flat_surface = SolidTimber03FlatSurface(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)
_04_closed_mesh = SolidTimber04ClosedMesh(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)
_05_open_mesh = SolidTimber05OpenMesh(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)
_06_trimmed_surface_with_hole = SolidTimber06TrimmedSurfaceWithHole(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)
_07_bowed_surface_automatic = SolidTimber07BowedSurfaceAutomatic(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)
_08_bowed_single_face_brep_automatic = SolidTimber08BowedSingleFaceBrepAutomatic(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)
_09_bowed_solid_brep_guide = SolidTimber09BowedSolidBrepGuide(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)
guide_mm = SolidTimber09BowedSolidBrepGuideGuide(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)
_10_bowed_extrusion_guide = SolidTimber10BowedExtrusionGuide(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)
guide_mm_2 = SolidTimber10BowedExtrusionGuideGuide(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)
_11_bowed_mesh_guide = SolidTimber11BowedMeshGuide(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)
guide_mm_3 = SolidTimber11BowedMeshGuideGuide(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)
# Woodie · Complete gallery: WOODIE | 8 PRODUCTS × 11 GEOMETRY CASES
# 
# Works in millimetre, metre and inch Rhino documents.
# Every preview declares Geometry Units = Millimetres.
# Source geometry remains unchanged.
# 
# Viewport rows = products; columns = geometry cases.
# Flat/bowed solid pairs are visible initially and have
# equal centreline lengths. Enable other preview
# components or a product group's preview to explore.
# 
# Each product uses its own representative thickness.
# Open surfaces stay open; presets are visual only.
timbermaterial = TimberMaterial(Seed=0, Resolution=8, Advanced=False, PanelExpanded=True, SelectedLook=1, SelectedProduct=5, WoodieMaterialVersion=3)  # -> Settings, Product
solid_timber_01_flat_solid_brep_matched = TimberPreview(Geometry=_01_flat_solid_brep_matched_length, Settings=timbermaterial.Settings, Show=True, GeometryUnits=millimetres)  # -> Meshes, Products, AlignedBox, Frame; "Solid timber / 01 Flat solid Brep (matched length)"
solid_timber_02_extrusion = TimberPreview(Geometry=_02_extrusion, Settings=timbermaterial.Settings, Show=True, GeometryUnits=millimetres)  # -> Meshes, Products, AlignedBox, Frame
solid_timber_03_flat_surface = TimberPreview(Geometry=_03_flat_surface, Settings=timbermaterial.Settings, Show=True, GeometryUnits=millimetres)  # -> Meshes, Products, AlignedBox, Frame
solid_timber_04_closed_mesh = TimberPreview(Geometry=_04_closed_mesh, Settings=timbermaterial.Settings, Show=True, GeometryUnits=millimetres)  # -> Meshes, Products, AlignedBox, Frame
solid_timber_05_open_mesh = TimberPreview(Geometry=_05_open_mesh, Settings=timbermaterial.Settings, Show=True, GeometryUnits=millimetres)  # -> Meshes, Products, AlignedBox, Frame
solid_timber_06_trimmed_surface_with_hol = TimberPreview(Geometry=_06_trimmed_surface_with_hole, Settings=timbermaterial.Settings, Show=True, GeometryUnits=millimetres)  # -> Meshes, Products, AlignedBox, Frame; "Solid timber / 06 Trimmed surface with hole"
solid_timber_07_bowed_surface_automatic = TimberPreview(Geometry=_07_bowed_surface_automatic, Settings=timbermaterial.Settings, Show=True, GeometryUnits=millimetres)  # -> Meshes, Products, AlignedBox, Frame
solid_timber_08_bowed_single_face_brep_a = TimberPreview(Geometry=_08_bowed_single_face_brep_automatic, Settings=timbermaterial.Settings, Show=True, GeometryUnits=millimetres)  # -> Meshes, Products, AlignedBox, Frame; "Solid timber / 08 Bowed single-face Brep - automatic"
solid_timber_09_bowed_solid_brep_guide = TimberPreview(
    Geometry=_09_bowed_solid_brep_guide,
    Settings=timbermaterial.Settings,
    BasePlane=PlaneXY(0, 0, 0),
    GuideCurve=guide_mm,
    Show=True,
    GeometryUnits=millimetres)  # -> Meshes, Products, AlignedBox, Frame
solid_timber_10_bowed_extrusion_guide = TimberPreview(
    Geometry=_10_bowed_extrusion_guide,
    Settings=timbermaterial.Settings,
    BasePlane=PlaneXY(0, 0, 0),
    GuideCurve=guide_mm_2,
    Show=True,
    GeometryUnits=millimetres)  # -> Meshes, Products, AlignedBox, Frame
solid_timber_11_bowed_mesh_guide = TimberPreview(
    Geometry=_11_bowed_mesh_guide,
    Settings=timbermaterial.Settings,
    BasePlane=PlaneXY(0, 0, 0),
    GuideCurve=guide_mm_3,
    Show=True,
    GeometryUnits=millimetres)  # -> Meshes, Products, AlignedBox, Frame

# ---- group: KVH · 120 mm · 11 cases
millimetres_2 = SourceCoordinateUnits("Millimetres")
_01_flat_solid_brep_matched_length_2 = KVH01FlatSolidBrepMatchedLength(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)
_02_extrusion_2 = KVH02Extrusion(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)
_03_flat_surface_2 = KVH03FlatSurface(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)
_04_closed_mesh_2 = KVH04ClosedMesh(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)
_05_open_mesh_2 = KVH05OpenMesh(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)
_06_trimmed_surface_with_hole_2 = KVH06TrimmedSurfaceWithHole(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)
_07_bowed_surface_automatic_2 = KVH07BowedSurfaceAutomatic(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)
_08_bowed_single_face_brep_automatic_2 = KVH08BowedSingleFaceBrepAutomatic(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)
_09_bowed_solid_brep_guide_2 = KVH09BowedSolidBrepGuide(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)
guide_mm_4 = KVH09BowedSolidBrepGuideGuide(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)
_10_bowed_extrusion_guide_2 = KVH10BowedExtrusionGuide(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)
guide_mm_5 = KVH10BowedExtrusionGuideGuide(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)
_11_bowed_mesh_guide_2 = KVH11BowedMeshGuide(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)
guide_mm_6 = KVH11BowedMeshGuideGuide(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)
timbermaterial_2 = TimberMaterial(Seed=0, Resolution=8, Advanced=False, PanelExpanded=True, SelectedLook=1, SelectedProduct=4, WoodieMaterialVersion=3)  # -> Settings, Product
kvh_01_flat_solid_brep_matched_length = TimberPreview(
    Geometry=_01_flat_solid_brep_matched_length_2,
    Settings=timbermaterial_2.Settings,
    Show=True,
    GeometryUnits=millimetres_2)  # -> Meshes, Products, AlignedBox, Frame
kvh_02_extrusion = TimberPreview(Geometry=_02_extrusion_2, Settings=timbermaterial_2.Settings, Show=True, GeometryUnits=millimetres_2)  # -> Meshes, Products, AlignedBox, Frame
kvh_03_flat_surface = TimberPreview(Geometry=_03_flat_surface_2, Settings=timbermaterial_2.Settings, Show=True, GeometryUnits=millimetres_2)  # -> Meshes, Products, AlignedBox, Frame
kvh_04_closed_mesh = TimberPreview(Geometry=_04_closed_mesh_2, Settings=timbermaterial_2.Settings, Show=True, GeometryUnits=millimetres_2)  # -> Meshes, Products, AlignedBox, Frame
kvh_05_open_mesh = TimberPreview(Geometry=_05_open_mesh_2, Settings=timbermaterial_2.Settings, Show=True, GeometryUnits=millimetres_2)  # -> Meshes, Products, AlignedBox, Frame
kvh_06_trimmed_surface_with_hole = TimberPreview(Geometry=_06_trimmed_surface_with_hole_2, Settings=timbermaterial_2.Settings, Show=True, GeometryUnits=millimetres_2)  # -> Meshes, Products, AlignedBox, Frame
kvh_07_bowed_surface_automatic = TimberPreview(Geometry=_07_bowed_surface_automatic_2, Settings=timbermaterial_2.Settings, Show=True, GeometryUnits=millimetres_2)  # -> Meshes, Products, AlignedBox, Frame
kvh_08_bowed_single_face_brep_automatic = TimberPreview(
    Geometry=_08_bowed_single_face_brep_automatic_2,
    Settings=timbermaterial_2.Settings,
    Show=True,
    GeometryUnits=millimetres_2)  # -> Meshes, Products, AlignedBox, Frame
kvh_09_bowed_solid_brep_guide = TimberPreview(
    Geometry=_09_bowed_solid_brep_guide_2,
    Settings=timbermaterial_2.Settings,
    BasePlane=PlaneXY(0, 0, 0),
    GuideCurve=guide_mm_4,
    Show=True,
    GeometryUnits=millimetres_2)  # -> Meshes, Products, AlignedBox, Frame
kvh_10_bowed_extrusion_guide = TimberPreview(
    Geometry=_10_bowed_extrusion_guide_2,
    Settings=timbermaterial_2.Settings,
    BasePlane=PlaneXY(0, 0, 0),
    GuideCurve=guide_mm_5,
    Show=True,
    GeometryUnits=millimetres_2)  # -> Meshes, Products, AlignedBox, Frame
kvh_11_bowed_mesh_guide = TimberPreview(
    Geometry=_11_bowed_mesh_guide_2,
    Settings=timbermaterial_2.Settings,
    BasePlane=PlaneXY(0, 0, 0),
    GuideCurve=guide_mm_6,
    Show=True,
    GeometryUnits=millimetres_2)  # -> Meshes, Products, AlignedBox, Frame

# ---- group: Glulam · 120 mm · 11 cases
millimetres_3 = SourceCoordinateUnits("Millimetres")
_01_flat_solid_brep_matched_length_3 = Glulam01FlatSolidBrepMatchedLength(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)
_02_extrusion_3 = Glulam02Extrusion(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)
_03_flat_surface_3 = Glulam03FlatSurface(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)
_04_closed_mesh_3 = Glulam04ClosedMesh(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)
_05_open_mesh_3 = Glulam05OpenMesh(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)
_06_trimmed_surface_with_hole_3 = Glulam06TrimmedSurfaceWithHole(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)
_07_bowed_surface_automatic_3 = Glulam07BowedSurfaceAutomatic(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)
_08_bowed_single_face_brep_automatic_3 = Glulam08BowedSingleFaceBrepAutomatic(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)
_09_bowed_solid_brep_guide_3 = Glulam09BowedSolidBrepGuide(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)
guide_mm_7 = Glulam09BowedSolidBrepGuideGuide(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)
_10_bowed_extrusion_guide_3 = Glulam10BowedExtrusionGuide(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)
guide_mm_8 = Glulam10BowedExtrusionGuideGuide(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)
_11_bowed_mesh_guide_3 = Glulam11BowedMeshGuide(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)
guide_mm_9 = Glulam11BowedMeshGuideGuide(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)
timbermaterial_3 = TimberMaterial(Seed=0, Resolution=8, Advanced=False, PanelExpanded=True, SelectedLook=1, SelectedProduct=2, WoodieMaterialVersion=3)  # -> Settings, Product
glulam_01_flat_solid_brep_matched_length = TimberPreview(
    Geometry=_01_flat_solid_brep_matched_length_3,
    Settings=timbermaterial_3.Settings,
    Show=True,
    GeometryUnits=millimetres_3)  # -> Meshes, Products, AlignedBox, Frame
glulam_02_extrusion = TimberPreview(Geometry=_02_extrusion_3, Settings=timbermaterial_3.Settings, Show=True, GeometryUnits=millimetres_3)  # -> Meshes, Products, AlignedBox, Frame
glulam_03_flat_surface = TimberPreview(Geometry=_03_flat_surface_3, Settings=timbermaterial_3.Settings, Show=True, GeometryUnits=millimetres_3)  # -> Meshes, Products, AlignedBox, Frame
glulam_04_closed_mesh = TimberPreview(Geometry=_04_closed_mesh_3, Settings=timbermaterial_3.Settings, Show=True, GeometryUnits=millimetres_3)  # -> Meshes, Products, AlignedBox, Frame
glulam_05_open_mesh = TimberPreview(Geometry=_05_open_mesh_3, Settings=timbermaterial_3.Settings, Show=True, GeometryUnits=millimetres_3)  # -> Meshes, Products, AlignedBox, Frame
glulam_06_trimmed_surface_with_hole = TimberPreview(Geometry=_06_trimmed_surface_with_hole_3, Settings=timbermaterial_3.Settings, Show=True, GeometryUnits=millimetres_3)  # -> Meshes, Products, AlignedBox, Frame
glulam_07_bowed_surface_automatic = TimberPreview(Geometry=_07_bowed_surface_automatic_3, Settings=timbermaterial_3.Settings, Show=True, GeometryUnits=millimetres_3)  # -> Meshes, Products, AlignedBox, Frame
glulam_08_bowed_single_face_brep_automat = TimberPreview(
    Geometry=_08_bowed_single_face_brep_automatic_3,
    Settings=timbermaterial_3.Settings,
    Show=True,
    GeometryUnits=millimetres_3)  # -> Meshes, Products, AlignedBox, Frame; "Glulam / 08 Bowed single-face Brep - automatic"
glulam_09_bowed_solid_brep_guide = TimberPreview(
    Geometry=_09_bowed_solid_brep_guide_3,
    Settings=timbermaterial_3.Settings,
    BasePlane=PlaneXY(0, 0, 0),
    GuideCurve=guide_mm_7,
    Show=True,
    GeometryUnits=millimetres_3)  # -> Meshes, Products, AlignedBox, Frame
glulam_10_bowed_extrusion_guide = TimberPreview(
    Geometry=_10_bowed_extrusion_guide_3,
    Settings=timbermaterial_3.Settings,
    BasePlane=PlaneXY(0, 0, 0),
    GuideCurve=guide_mm_8,
    Show=True,
    GeometryUnits=millimetres_3)  # -> Meshes, Products, AlignedBox, Frame
glulam_11_bowed_mesh_guide = TimberPreview(
    Geometry=_11_bowed_mesh_guide_3,
    Settings=timbermaterial_3.Settings,
    BasePlane=PlaneXY(0, 0, 0),
    GuideCurve=guide_mm_9,
    Show=True,
    GeometryUnits=millimetres_3)  # -> Meshes, Products, AlignedBox, Frame

# ---- group: CLT · 200 mm · 11 cases
millimetres_4 = SourceCoordinateUnits("Millimetres")
_01_flat_solid_brep_matched_length_4 = CLT01FlatSolidBrepMatchedLength(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)
_02_extrusion_4 = CLT02Extrusion(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)
_03_flat_surface_4 = CLT03FlatSurface(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)
_04_closed_mesh_4 = CLT04ClosedMesh(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)
_05_open_mesh_4 = CLT05OpenMesh(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)
_06_trimmed_surface_with_hole_4 = CLT06TrimmedSurfaceWithHole(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)
_07_bowed_surface_automatic_4 = CLT07BowedSurfaceAutomatic(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)
_08_bowed_single_face_brep_automatic_4 = CLT08BowedSingleFaceBrepAutomatic(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)
_09_bowed_solid_brep_guide_4 = CLT09BowedSolidBrepGuide(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)
guide_mm_10 = CLT09BowedSolidBrepGuideGuide(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)
_10_bowed_extrusion_guide_4 = CLT10BowedExtrusionGuide(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)
guide_mm_11 = CLT10BowedExtrusionGuideGuide(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)
_11_bowed_mesh_guide_4 = CLT11BowedMeshGuide(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)
guide_mm_12 = CLT11BowedMeshGuideGuide(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)
timbermaterial_4 = TimberMaterial(Seed=0, Resolution=8, Advanced=False, PanelExpanded=True, SelectedLook=1, SelectedProduct=0, WoodieMaterialVersion=3)  # -> Settings, Product
clt_01_flat_solid_brep_matched_length = TimberPreview(
    Geometry=_01_flat_solid_brep_matched_length_4,
    Settings=timbermaterial_4.Settings,
    Show=True,
    GeometryUnits=millimetres_4)  # -> Meshes, Products, AlignedBox, Frame
clt_02_extrusion = TimberPreview(Geometry=_02_extrusion_4, Settings=timbermaterial_4.Settings, Show=True, GeometryUnits=millimetres_4)  # -> Meshes, Products, AlignedBox, Frame
clt_03_flat_surface = TimberPreview(Geometry=_03_flat_surface_4, Settings=timbermaterial_4.Settings, Show=True, GeometryUnits=millimetres_4)  # -> Meshes, Products, AlignedBox, Frame
clt_04_closed_mesh = TimberPreview(Geometry=_04_closed_mesh_4, Settings=timbermaterial_4.Settings, Show=True, GeometryUnits=millimetres_4)  # -> Meshes, Products, AlignedBox, Frame
clt_05_open_mesh = TimberPreview(Geometry=_05_open_mesh_4, Settings=timbermaterial_4.Settings, Show=True, GeometryUnits=millimetres_4)  # -> Meshes, Products, AlignedBox, Frame
clt_06_trimmed_surface_with_hole = TimberPreview(Geometry=_06_trimmed_surface_with_hole_4, Settings=timbermaterial_4.Settings, Show=True, GeometryUnits=millimetres_4)  # -> Meshes, Products, AlignedBox, Frame
clt_07_bowed_surface_automatic = TimberPreview(Geometry=_07_bowed_surface_automatic_4, Settings=timbermaterial_4.Settings, Show=True, GeometryUnits=millimetres_4)  # -> Meshes, Products, AlignedBox, Frame
clt_08_bowed_single_face_brep_automatic = TimberPreview(
    Geometry=_08_bowed_single_face_brep_automatic_4,
    Settings=timbermaterial_4.Settings,
    Show=True,
    GeometryUnits=millimetres_4)  # -> Meshes, Products, AlignedBox, Frame
clt_09_bowed_solid_brep_guide = TimberPreview(
    Geometry=_09_bowed_solid_brep_guide_4,
    Settings=timbermaterial_4.Settings,
    BasePlane=PlaneXY(0, 0, 0),
    GuideCurve=guide_mm_10,
    Show=True,
    GeometryUnits=millimetres_4)  # -> Meshes, Products, AlignedBox, Frame
clt_10_bowed_extrusion_guide = TimberPreview(
    Geometry=_10_bowed_extrusion_guide_4,
    Settings=timbermaterial_4.Settings,
    BasePlane=PlaneXY(0, 0, 0),
    GuideCurve=guide_mm_11,
    Show=True,
    GeometryUnits=millimetres_4)  # -> Meshes, Products, AlignedBox, Frame
clt_11_bowed_mesh_guide = TimberPreview(
    Geometry=_11_bowed_mesh_guide_4,
    Settings=timbermaterial_4.Settings,
    BasePlane=PlaneXY(0, 0, 0),
    GuideCurve=guide_mm_12,
    Show=True,
    GeometryUnits=millimetres_4)  # -> Meshes, Products, AlignedBox, Frame

# ---- group: Three-layer panel · 27 mm · 11 cases
millimetres_5 = SourceCoordinateUnits("Millimetres")
_01_flat_solid_brep_matched_length_5 = ThreeLayerPanel01FlatSolidBrepMatchedLength(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)
_02_extrusion_5 = ThreeLayerPanel02Extrusion(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)
_03_flat_surface_5 = ThreeLayerPanel03FlatSurface(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)
_04_closed_mesh_5 = ThreeLayerPanel04ClosedMesh(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)
_05_open_mesh_5 = ThreeLayerPanel05OpenMesh(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)
_06_trimmed_surface_with_hole_5 = ThreeLayerPanel06TrimmedSurfaceWithHole(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)
_07_bowed_surface_automatic_5 = ThreeLayerPanel07BowedSurfaceAutomatic(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)
_08_bowed_single_face_brep_automatic_5 = ThreeLayerPanel08BowedSingleFaceBrepAutomatic(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)
_09_bowed_solid_brep_guide_5 = ThreeLayerPanel09BowedSolidBrepGuide(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)
guide_mm_13 = ThreeLayerPanel09BowedSolidBrepGuideGuide(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)
_10_bowed_extrusion_guide_5 = ThreeLayerPanel10BowedExtrusionGuide(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)
guide_mm_14 = ThreeLayerPanel10BowedExtrusionGuideGuide(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)
_11_bowed_mesh_guide_5 = ThreeLayerPanel11BowedMeshGuide(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)
guide_mm_15 = ThreeLayerPanel11BowedMeshGuideGuide(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)
timbermaterial_5 = TimberMaterial(Seed=0, Resolution=8, Advanced=False, PanelExpanded=True, SelectedLook=1, SelectedProduct=1, WoodieMaterialVersion=3)  # -> Settings, Product
three_layer_panel_01_flat_solid_brep_mat = TimberPreview(
    Geometry=_01_flat_solid_brep_matched_length_5,
    Settings=timbermaterial_5.Settings,
    Show=True,
    GeometryUnits=millimetres_5)  # -> Meshes, Products, AlignedBox, Frame; "Three-layer panel / 01 Flat solid Brep (matched length)"
three_layer_panel_02_extrusion = TimberPreview(Geometry=_02_extrusion_5, Settings=timbermaterial_5.Settings, Show=True, GeometryUnits=millimetres_5)  # -> Meshes, Products, AlignedBox, Frame
three_layer_panel_03_flat_surface = TimberPreview(Geometry=_03_flat_surface_5, Settings=timbermaterial_5.Settings, Show=True, GeometryUnits=millimetres_5)  # -> Meshes, Products, AlignedBox, Frame
three_layer_panel_04_closed_mesh = TimberPreview(Geometry=_04_closed_mesh_5, Settings=timbermaterial_5.Settings, Show=True, GeometryUnits=millimetres_5)  # -> Meshes, Products, AlignedBox, Frame
three_layer_panel_05_open_mesh = TimberPreview(Geometry=_05_open_mesh_5, Settings=timbermaterial_5.Settings, Show=True, GeometryUnits=millimetres_5)  # -> Meshes, Products, AlignedBox, Frame
three_layer_panel_06_trimmed_surface_wit = TimberPreview(Geometry=_06_trimmed_surface_with_hole_5, Settings=timbermaterial_5.Settings, Show=True, GeometryUnits=millimetres_5)  # -> Meshes, Products, AlignedBox, Frame; "Three-layer panel / 06 Trimmed surface with hole"
three_layer_panel_07_bowed_surface_autom = TimberPreview(Geometry=_07_bowed_surface_automatic_5, Settings=timbermaterial_5.Settings, Show=True, GeometryUnits=millimetres_5)  # -> Meshes, Products, AlignedBox, Frame; "Three-layer panel / 07 Bowed surface - automatic"
three_layer_panel_08_bowed_single_face_b = TimberPreview(
    Geometry=_08_bowed_single_face_brep_automatic_5,
    Settings=timbermaterial_5.Settings,
    Show=True,
    GeometryUnits=millimetres_5)  # -> Meshes, Products, AlignedBox, Frame; "Three-layer panel / 08 Bowed single-face Brep - automatic"
three_layer_panel_09_bowed_solid_brep_gu = TimberPreview(
    Geometry=_09_bowed_solid_brep_guide_5,
    Settings=timbermaterial_5.Settings,
    BasePlane=PlaneXY(0, 0, 0),
    GuideCurve=guide_mm_13,
    Show=True,
    GeometryUnits=millimetres_5)  # -> Meshes, Products, AlignedBox, Frame; "Three-layer panel / 09 Bowed solid Brep - guide"
three_layer_panel_10_bowed_extrusion_gui = TimberPreview(
    Geometry=_10_bowed_extrusion_guide_5,
    Settings=timbermaterial_5.Settings,
    BasePlane=PlaneXY(0, 0, 0),
    GuideCurve=guide_mm_14,
    Show=True,
    GeometryUnits=millimetres_5)  # -> Meshes, Products, AlignedBox, Frame; "Three-layer panel / 10 Bowed extrusion - guide"
three_layer_panel_11_bowed_mesh_guide = TimberPreview(
    Geometry=_11_bowed_mesh_guide_5,
    Settings=timbermaterial_5.Settings,
    BasePlane=PlaneXY(0, 0, 0),
    GuideCurve=guide_mm_15,
    Show=True,
    GeometryUnits=millimetres_5)  # -> Meshes, Products, AlignedBox, Frame

# ---- group: Plywood · 18 mm · 11 cases
millimetres_6 = SourceCoordinateUnits("Millimetres")
_01_flat_solid_brep_matched_length_6 = Plywood01FlatSolidBrepMatchedLength(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)
_02_extrusion_6 = Plywood02Extrusion(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)
_03_flat_surface_6 = Plywood03FlatSurface(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)
_04_closed_mesh_6 = Plywood04ClosedMesh(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)
_05_open_mesh_6 = Plywood05OpenMesh(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)
_06_trimmed_surface_with_hole_6 = Plywood06TrimmedSurfaceWithHole(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)
_07_bowed_surface_automatic_6 = Plywood07BowedSurfaceAutomatic(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)
_08_bowed_single_face_brep_automatic_6 = Plywood08BowedSingleFaceBrepAutomatic(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)
_09_bowed_solid_brep_guide_6 = Plywood09BowedSolidBrepGuide(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)
guide_mm_16 = Plywood09BowedSolidBrepGuideGuide(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)
_10_bowed_extrusion_guide_6 = Plywood10BowedExtrusionGuide(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)
guide_mm_17 = Plywood10BowedExtrusionGuideGuide(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)
_11_bowed_mesh_guide_6 = Plywood11BowedMeshGuide(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)
guide_mm_18 = Plywood11BowedMeshGuideGuide(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)
timbermaterial_6 = TimberMaterial(Seed=0, Resolution=8, Advanced=False, PanelExpanded=True, SelectedLook=1, SelectedProduct=6, WoodieMaterialVersion=3)  # -> Settings, Product
plywood_01_flat_solid_brep_matched_lengt = TimberPreview(
    Geometry=_01_flat_solid_brep_matched_length_6,
    Settings=timbermaterial_6.Settings,
    Show=True,
    GeometryUnits=millimetres_6)  # -> Meshes, Products, AlignedBox, Frame; "Plywood / 01 Flat solid Brep (matched length)"
plywood_02_extrusion = TimberPreview(Geometry=_02_extrusion_6, Settings=timbermaterial_6.Settings, Show=True, GeometryUnits=millimetres_6)  # -> Meshes, Products, AlignedBox, Frame
plywood_03_flat_surface = TimberPreview(Geometry=_03_flat_surface_6, Settings=timbermaterial_6.Settings, Show=True, GeometryUnits=millimetres_6)  # -> Meshes, Products, AlignedBox, Frame
plywood_04_closed_mesh = TimberPreview(Geometry=_04_closed_mesh_6, Settings=timbermaterial_6.Settings, Show=True, GeometryUnits=millimetres_6)  # -> Meshes, Products, AlignedBox, Frame
plywood_05_open_mesh = TimberPreview(Geometry=_05_open_mesh_6, Settings=timbermaterial_6.Settings, Show=True, GeometryUnits=millimetres_6)  # -> Meshes, Products, AlignedBox, Frame
plywood_06_trimmed_surface_with_hole = TimberPreview(Geometry=_06_trimmed_surface_with_hole_6, Settings=timbermaterial_6.Settings, Show=True, GeometryUnits=millimetres_6)  # -> Meshes, Products, AlignedBox, Frame
plywood_07_bowed_surface_automatic = TimberPreview(Geometry=_07_bowed_surface_automatic_6, Settings=timbermaterial_6.Settings, Show=True, GeometryUnits=millimetres_6)  # -> Meshes, Products, AlignedBox, Frame
plywood_08_bowed_single_face_brep_automa = TimberPreview(
    Geometry=_08_bowed_single_face_brep_automatic_6,
    Settings=timbermaterial_6.Settings,
    Show=True,
    GeometryUnits=millimetres_6)  # -> Meshes, Products, AlignedBox, Frame; "Plywood / 08 Bowed single-face Brep - automatic"
plywood_09_bowed_solid_brep_guide = TimberPreview(
    Geometry=_09_bowed_solid_brep_guide_6,
    Settings=timbermaterial_6.Settings,
    BasePlane=PlaneXY(0, 0, 0),
    GuideCurve=guide_mm_16,
    Show=True,
    GeometryUnits=millimetres_6)  # -> Meshes, Products, AlignedBox, Frame
plywood_10_bowed_extrusion_guide = TimberPreview(
    Geometry=_10_bowed_extrusion_guide_6,
    Settings=timbermaterial_6.Settings,
    BasePlane=PlaneXY(0, 0, 0),
    GuideCurve=guide_mm_17,
    Show=True,
    GeometryUnits=millimetres_6)  # -> Meshes, Products, AlignedBox, Frame
plywood_11_bowed_mesh_guide = TimberPreview(
    Geometry=_11_bowed_mesh_guide_6,
    Settings=timbermaterial_6.Settings,
    BasePlane=PlaneXY(0, 0, 0),
    GuideCurve=guide_mm_18,
    Show=True,
    GeometryUnits=millimetres_6)  # -> Meshes, Products, AlignedBox, Frame

# ---- group: LVL — parallel · 45 mm · 11 cases
millimetres_7 = SourceCoordinateUnits("Millimetres")
_01_flat_solid_brep_matched_length_7 = LVLParallel01FlatSolidBrepMatchedLength(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)
_02_extrusion_7 = LVLParallel02Extrusion(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)
_03_flat_surface_7 = LVLParallel03FlatSurface(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)
_04_closed_mesh_7 = LVLParallel04ClosedMesh(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)
_05_open_mesh_7 = LVLParallel05OpenMesh(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)
_06_trimmed_surface_with_hole_7 = LVLParallel06TrimmedSurfaceWithHole(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)
_07_bowed_surface_automatic_7 = LVLParallel07BowedSurfaceAutomatic(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)
_08_bowed_single_face_brep_automatic_7 = LVLParallel08BowedSingleFaceBrepAutomatic(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)
_09_bowed_solid_brep_guide_7 = LVLParallel09BowedSolidBrepGuide(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)
guide_mm_19 = LVLParallel09BowedSolidBrepGuideGuide(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)
_10_bowed_extrusion_guide_7 = LVLParallel10BowedExtrusionGuide(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)
guide_mm_20 = LVLParallel10BowedExtrusionGuideGuide(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)
_11_bowed_mesh_guide_7 = LVLParallel11BowedMeshGuide(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)
guide_mm_21 = LVLParallel11BowedMeshGuideGuide(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)
timbermaterial_7 = TimberMaterial(Seed=0, Resolution=8, Advanced=False, PanelExpanded=True, SelectedLook=1, SelectedProduct=7, WoodieMaterialVersion=3)  # -> Settings, Product
lvl_parallel_01_flat_solid_brep_matched = TimberPreview(
    Geometry=_01_flat_solid_brep_matched_length_7,
    Settings=timbermaterial_7.Settings,
    Show=True,
    GeometryUnits=millimetres_7)  # -> Meshes, Products, AlignedBox, Frame; "LVL — parallel / 01 Flat solid Brep (matched length)"
lvl_parallel_02_extrusion = TimberPreview(Geometry=_02_extrusion_7, Settings=timbermaterial_7.Settings, Show=True, GeometryUnits=millimetres_7)  # -> Meshes, Products, AlignedBox, Frame
lvl_parallel_03_flat_surface = TimberPreview(Geometry=_03_flat_surface_7, Settings=timbermaterial_7.Settings, Show=True, GeometryUnits=millimetres_7)  # -> Meshes, Products, AlignedBox, Frame
lvl_parallel_04_closed_mesh = TimberPreview(Geometry=_04_closed_mesh_7, Settings=timbermaterial_7.Settings, Show=True, GeometryUnits=millimetres_7)  # -> Meshes, Products, AlignedBox, Frame
lvl_parallel_05_open_mesh = TimberPreview(Geometry=_05_open_mesh_7, Settings=timbermaterial_7.Settings, Show=True, GeometryUnits=millimetres_7)  # -> Meshes, Products, AlignedBox, Frame
lvl_parallel_06_trimmed_surface_with_hol = TimberPreview(Geometry=_06_trimmed_surface_with_hole_7, Settings=timbermaterial_7.Settings, Show=True, GeometryUnits=millimetres_7)  # -> Meshes, Products, AlignedBox, Frame; "LVL — parallel / 06 Trimmed surface with hole"
lvl_parallel_07_bowed_surface_automatic = TimberPreview(Geometry=_07_bowed_surface_automatic_7, Settings=timbermaterial_7.Settings, Show=True, GeometryUnits=millimetres_7)  # -> Meshes, Products, AlignedBox, Frame
lvl_parallel_08_bowed_single_face_brep_a = TimberPreview(
    Geometry=_08_bowed_single_face_brep_automatic_7,
    Settings=timbermaterial_7.Settings,
    Show=True,
    GeometryUnits=millimetres_7)  # -> Meshes, Products, AlignedBox, Frame; "LVL — parallel / 08 Bowed single-face Brep - automatic"
lvl_parallel_09_bowed_solid_brep_guide = TimberPreview(
    Geometry=_09_bowed_solid_brep_guide_7,
    Settings=timbermaterial_7.Settings,
    BasePlane=PlaneXY(0, 0, 0),
    GuideCurve=guide_mm_19,
    Show=True,
    GeometryUnits=millimetres_7)  # -> Meshes, Products, AlignedBox, Frame
lvl_parallel_10_bowed_extrusion_guide = TimberPreview(
    Geometry=_10_bowed_extrusion_guide_7,
    Settings=timbermaterial_7.Settings,
    BasePlane=PlaneXY(0, 0, 0),
    GuideCurve=guide_mm_20,
    Show=True,
    GeometryUnits=millimetres_7)  # -> Meshes, Products, AlignedBox, Frame
lvl_parallel_11_bowed_mesh_guide = TimberPreview(
    Geometry=_11_bowed_mesh_guide_7,
    Settings=timbermaterial_7.Settings,
    BasePlane=PlaneXY(0, 0, 0),
    GuideCurve=guide_mm_21,
    Show=True,
    GeometryUnits=millimetres_7)  # -> Meshes, Products, AlignedBox, Frame

# ---- group: Kerto-Q · 45 mm · 11 cases
millimetres_8 = SourceCoordinateUnits("Millimetres")
_01_flat_solid_brep_matched_length_8 = KertoQ01FlatSolidBrepMatchedLength(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)
_02_extrusion_8 = KertoQ02Extrusion(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)
_03_flat_surface_8 = KertoQ03FlatSurface(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)
_04_closed_mesh_8 = KertoQ04ClosedMesh(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)
_05_open_mesh_8 = KertoQ05OpenMesh(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)
_06_trimmed_surface_with_hole_8 = KertoQ06TrimmedSurfaceWithHole(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)
_07_bowed_surface_automatic_8 = KertoQ07BowedSurfaceAutomatic(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)
_08_bowed_single_face_brep_automatic_8 = KertoQ08BowedSingleFaceBrepAutomatic(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)
_09_bowed_solid_brep_guide_8 = KertoQ09BowedSolidBrepGuide(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)
guide_mm_22 = KertoQ09BowedSolidBrepGuideGuide(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)
_10_bowed_extrusion_guide_8 = KertoQ10BowedExtrusionGuide(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)
guide_mm_23 = KertoQ10BowedExtrusionGuideGuide(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)
_11_bowed_mesh_guide_8 = KertoQ11BowedMeshGuide(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)
guide_mm_24 = KertoQ11BowedMeshGuideGuide(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)
timbermaterial_8 = TimberMaterial(Seed=0, Resolution=8, Advanced=False, PanelExpanded=True, SelectedLook=1, SelectedProduct=3, WoodieMaterialVersion=3)  # -> Settings, Product
kerto_q_01_flat_solid_brep_matched_lengt = TimberPreview(
    Geometry=_01_flat_solid_brep_matched_length_8,
    Settings=timbermaterial_8.Settings,
    Show=True,
    GeometryUnits=millimetres_8)  # -> Meshes, Products, AlignedBox, Frame; "Kerto-Q / 01 Flat solid Brep (matched length)"
kerto_q_02_extrusion = TimberPreview(Geometry=_02_extrusion_8, Settings=timbermaterial_8.Settings, Show=True, GeometryUnits=millimetres_8)  # -> Meshes, Products, AlignedBox, Frame
kerto_q_03_flat_surface = TimberPreview(Geometry=_03_flat_surface_8, Settings=timbermaterial_8.Settings, Show=True, GeometryUnits=millimetres_8)  # -> Meshes, Products, AlignedBox, Frame
kerto_q_04_closed_mesh = TimberPreview(Geometry=_04_closed_mesh_8, Settings=timbermaterial_8.Settings, Show=True, GeometryUnits=millimetres_8)  # -> Meshes, Products, AlignedBox, Frame
kerto_q_05_open_mesh = TimberPreview(Geometry=_05_open_mesh_8, Settings=timbermaterial_8.Settings, Show=True, GeometryUnits=millimetres_8)  # -> Meshes, Products, AlignedBox, Frame
kerto_q_06_trimmed_surface_with_hole = TimberPreview(Geometry=_06_trimmed_surface_with_hole_8, Settings=timbermaterial_8.Settings, Show=True, GeometryUnits=millimetres_8)  # -> Meshes, Products, AlignedBox, Frame
kerto_q_07_bowed_surface_automatic = TimberPreview(Geometry=_07_bowed_surface_automatic_8, Settings=timbermaterial_8.Settings, Show=True, GeometryUnits=millimetres_8)  # -> Meshes, Products, AlignedBox, Frame
kerto_q_08_bowed_single_face_brep_automa = TimberPreview(
    Geometry=_08_bowed_single_face_brep_automatic_8,
    Settings=timbermaterial_8.Settings,
    Show=True,
    GeometryUnits=millimetres_8)  # -> Meshes, Products, AlignedBox, Frame; "Kerto-Q / 08 Bowed single-face Brep - automatic"
kerto_q_09_bowed_solid_brep_guide = TimberPreview(
    Geometry=_09_bowed_solid_brep_guide_8,
    Settings=timbermaterial_8.Settings,
    BasePlane=PlaneXY(0, 0, 0),
    GuideCurve=guide_mm_22,
    Show=True,
    GeometryUnits=millimetres_8)  # -> Meshes, Products, AlignedBox, Frame
kerto_q_10_bowed_extrusion_guide = TimberPreview(
    Geometry=_10_bowed_extrusion_guide_8,
    Settings=timbermaterial_8.Settings,
    BasePlane=PlaneXY(0, 0, 0),
    GuideCurve=guide_mm_23,
    Show=True,
    GeometryUnits=millimetres_8)  # -> Meshes, Products, AlignedBox, Frame
kerto_q_11_bowed_mesh_guide = TimberPreview(
    Geometry=_11_bowed_mesh_guide_8,
    Settings=timbermaterial_8.Settings,
    BasePlane=PlaneXY(0, 0, 0),
    GuideCurve=guide_mm_24,
    Show=True,
    GeometryUnits=millimetres_8)  # -> Meshes, Products, AlignedBox, Frame
